# Grasshopper definition 3DPrintingComponentsDemo.gh (Grasshopper 1.0.7)
# plug-ins: SpaceFactory

surface = Surface(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)
construct_point = ConstructPoint(XCoordinate=0, YCoordinate=0, ZCoordinate=0)
unit_z = UnitZ(Factor=1)
contour = Contour(Shape=surface, Point=construct_point, Direction=unit_z, Distance=Slider(5, range=0..10))
curve = Curve(flatten(contour))
list_item = ListItem(List=curve, Index=0, Wrap=True)
divide_curve = DivideCurve(Curve=list_item, Count=Slider(200, range=0..1000), Kinks=False)  # -> Points, Tangents, Parameters
# calculate displacement
calculatedisplacement = CalculateDisplacement(Contours=curve, BasePoints=divide_curve.Points)  # -> RemappedPoints, Displacement
# create mesh
createmesh = CreateMesh(Contours=curve, BasePoints=divide_curve.Points)
sort_list = SortList(Keys=flatten(calculatedisplacement.Displacement))  # -> Keys, ValuesValuesA
list_item_2 = ListItem(List=sort_list.Keys, Index="-1", Wrap=True)
gradient = Gradient(
    LowerLimit=0,
    UpperLimit=list_item_2,
    Parameter=calculatedisplacement.Displacement,
    stops=[0: RGB(115, 0, 255), 1: RGB(242, 0, 255)])
custom_preview = CustomPreview(Geometry=calculatedisplacement.RemappedPoints, Material=gradient)
